# Grasshopper definition grasshopper_template.gh (Grasshopper 1.0.7)
# plug-ins: MetaHopper

pt = Point(Point(0, 0, 0))
pt_2 = Point(Point(0, 0, 0))

# ---- group: Update group properties
list = ValueList({"Ext_Inputs": 0, "RH_Inputs": 1, "GH_Inputs": 2, "Operation": 3, "Output": 4, "Visualization": 5}, selected="GH_Inputs")
list_2 = ValueList({"Transparent": 120, "Opaque": 255}, selected="Opaque")
list_3 = ValueList({"Normal": 0, "Faint": 1, "Hidden": 2}, selected="Normal")
selobj = GetSelectedObjects()  # -> ComponentObjects, ParamObjects, OtherObjects
objfromgroup = GetObjectsInGroup(Group=selobj.OtherObjects)
cluster = Cluster(P=list, A=list_2)
# USE COLOURS TO KEEP SCRIPTS ORGANISED: Use MM's corporate colours per the legend.
# Single grouped elements: Alpha: 225.
# Large grouped elements: Alpha:120. Keep single grouped elements colour as below.
# "RH_Inputs" [Rhino Inputs]: ORANGE. RGB: 233, 90, 26.
# "Ext_Inputs" [Other external inputs, e.g. csv file]: GOLD. RGB: 248, 172, 4.
# "GH_Inputs" [User variables in GH]: YELLOW. RGB: 255, 212, 0.
# "Operations" [Functions and Sub-routines]: PURPLE. RGB: 142, 63, 145.
# "Outputs" [Outputs from each function/sub-routine]: PINK. RGB: 225, 39, 141.
# "Visualization" [Items for visualisation]: GREEN. RGB: 175, 194, 54.
# "Not Used" [Items no longer used or work in progress]: DARK BLUE. RGB: 33, 107, 153.
# "Notes" [code comments, notes to users, instructions]: WHITE. RGB: 255, 255, 255. A: 255.
wiredisplay = ControlWireDisplay(
    Objects=objfromgroup,
    WireDisplay=list_3,
    AllObjects_Object=[push_to_clone, push_to_github, include_rhino, package_script])
# OTHER TIPS: All inputs listed on left.
# All outputs listed on right.
# Include General Notes in the space provided in this titleblock.
# Global Instructions at top left corner on white.
# Local Instructions next to GH code on white.
# Large Header for each "Step" above GH code.
# Frequently label GH components for description.
# Use the colour palette (Mott MacDonald's branding) provided under Legend for Visualisation of elements in Rhino viewport.
# Refer to "Best Practices for keeping your Grasshopper definitions alive" for more tips on keeping your scripts organised.
setgroup = SetGroupProperties(Group=selobj.OtherObjects, Color=cluster)

# ----
# Best Practices for keeping your Grasshopper definitions alive: https://mottmac.sharepoint.com/:w:/s/AdvancedComputationalDesign/ETc57OF71k1BvT7oosb6fWUBobpmHxQIpNgOoV4gIkcuRA?e=IrvHvR
docinfo = DocumentInfo(AutoUpdate=True, Recursive=True)  # -> DocumentName, DocumentFilePath, Components, Params, _3rdPartyAssemblies
plugins = Plugins(_0_1=flatten(docinfo._3rdPartyAssemblies))  # -> simplify(result)
list_of_plugins = Panel(docinfo._3rdPartyAssemblies)

# ---- group: Images and username
# Include your sketches as part of your notes: Use Image Gallery to upload any sketches to support how you have defined/named the elements in your GH script.
# Double-click Image Gallery component and upload your image to 'Local images' by dragging and dropping the image to the container.
gallery = ImageGallery(CycleDelay=30, Randomize=False, UseLocalImages=True, UseRemoteImages=True)
python = GhPythonScript()  # -> out, a
# ---------- python: Python ----------
""" Disclaimer: This source code has been prepared for a specific purpose and should not be relied upon or used for any other purpose
 without an independent check being carried out as to its suitability and prior written authority of Mott MacDonald being
 obtained.  Mott MacDonald accepts no responsibility or liability for the consequence of this code being used for a purpose
 other than the purposes for which it was commissioned. Any person using or relying on the code for such other purpose
 agrees, and will by such use or reliance be taken to confirm his agreement to indemnify Mott MacDonald for all loss or
 damage resulting therefrom. Mott MacDonald accepts no responsibility or liability for this code to any party other than the
 person by whom it was commissioned.

(c) Mott MacDonald

-----------------------------------------------------------------------------------
    Describe your Inputs (adjust name of variables to suit your script):
        
    x: The x script variable
    y: The y script variable

    Describe your Output (adjust name of variables to suit your script):
        a: The a output variable
        
    Please comment your scripts adding in clear notes which explain the purpose of functions throughout the script
    
        """

__author__ = "MIN86062"
__version__ = "2018.09.04"

import rhinoscriptsyntax as rs
# ---------- end python ----------
vb = VBScript()  # -> out, A
# ---------- vb: VB usings ----------
''' <disclaimer>
'''-----------------------------------------------------------------------------------
'''Disclaimer: This source code has been prepared for a specific purpose and should not be relied upon or used for any other purpose 
'''without an independent check being carried out As To its suitability And prior written authority Of Mott MacDonald being
'''obtained.  Mott MacDonald accepts no responsibility Or liability For the consequence Of this code being used For a purpose
'''other than the purposes For which it was commissioned. Any person Using Or relying On the code For such other purpose
'''agrees, And will By such use Or reliance be taken To confirm his agreement To indemnify Mott MacDonald For all loss Or
'''damage resulting therefrom. Mott MacDonald accepts no responsibility Or liability For this code To any party other than the
'''person By whom it was commissioned.
'''(c) Mott MacDonald
'''-----------------------------------------------------------------------------------
'''</disclaimer>

'''<notes> 
'''-----------------------------------------------------------------------------------
'''Describe your Inputs (adjust name Of variables To suit your script):
'''x: The x script variable
'''y: The y script variable

'''Describe your Output (adjust name Of variables To suit your script):
'''a: The a output variable
        
'''Please comment your scripts including clear notes which explain the purpose of functions used throughout the script
'''-----------------------------------------------------------------------------------
'''</notes>
# ---------- end vb ----------
cluster_2 = Cluster_3(script_file_path_automatic=docinfo.DocumentFilePath, C=Toggle(False))  # -> file_name, username, P
c_script = CSharpScript()  # -> Out, A
file_name = Panel(cluster_2.file_name)
canvascap = Panel(cluster_2.P)
username = Panel(cluster_2.username)

# ----
practice = ValueList({"INSERT HERE", "Built Environment", "Transport", "Water"}, selected="INSERT HERE")
sector = ValueList({"INSERT HERE", "Building Structures", "Building Siences", "Building Services", "Facades"}, selected="INSERT HERE")

# ----
# Install GIT and
# create repository:
# Add a message
# Enter file Info
# Enter your GitHub Info:
list_4 = ValueList({"Download GIT": 0, "Open GitHub": 1}, selected="Open GitHub")
email = Panel("tatjana.somova@mottmac.com")
repository_name = Panel("grasshopper_template")
push_to_clone = Button()
github_username = Panel("INSERT HERE")
url = URL(data=list_4)  # -> R, out
file_description = Panel("INSERT HERE")
instructions = Panel("Insert instructions on how to run the code here.")
merge = Merge(Data1=practice, Data2=sector, Data3=github_username, Data4=email)
changes_log = Panel("Updated Grasshopper / Rhino file")
push_to_github = BooleanToggle(False)

include_rhino = BooleanToggle(False)
package_script = BooleanToggle(False)

list_5 = ValueList({"Simple", "Moderate", "Hard"}, selected="Simple")

clone = Clone(
    gh_user_email=email,
    gh_user_name="mottmacdonaldglobal",
    user_name=username,
    repository_name=repository_name,
    clone=push_to_clone)  # -> targetfolder, url, report, help
repository = GitHub_Repository(
    fileName=file_name,
    difficulty=list_5,
    installation=flatten(plugins),
    version=7,
    ownership=merge,
    Repository_Name=repository_name,
    fileDescription=file_description,
    instructions=instructions,
    targetFolder=clone.targetfolder,
    includeRhino=include_rhino,
    export=package_script)  # -> a, readMe; inputs installation: list, ownership: list, fileDescription: list, instructions: list, changeLog: list, fileTags: list, additionalImgs: list; plug-in component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
cluster_3 = Cluster_2(message=changes_log, push=push_to_github)  # -> report, help
local_folder_path = Panel(clone.targetfolder)

local_folder_path_2 = Panel(repository.a)

# ==== cluster Cluster
orange = ColourSwatch(SwatchColor=RGB(233, 90, 26))
yellow = ColourSwatch(SwatchColor=RGB(255, 212, 0))
purple = ColourSwatch(SwatchColor=RGB(142, 63, 145))
green = ColourSwatch(SwatchColor=RGB(175, 194, 54))
gold = ColourSwatch(SwatchColor=RGB(248, 172, 4))
blue = ColourSwatch(SwatchColor=RGB(33, 85, 117))
pink = ColourSwatch(SwatchColor=RGB(225, 39, 141))
P = ClusterInput()
p_n_c = PickNChoose(Pattern=P, Stream0=orange, Stream1=gold, Stream2=yellow, Stream3=purple, Stream4=pink, Stream5=green, Stream6=blue)
split = TextSplit(Text=p_n_c, Separators=",")
A = ClusterInput()
item = ListItem(List=split, Index=0, Wrap=True)  # -> Item, Item1, Item2
rgb = ColourRGB(Alpha=A, Red=item.Item, Green=item.Item1, Blue=item.Item2)
C = ClusterOutput(rgb)

# ==== cluster URL
data = ClusterInput()
data_2 = Data(data)
item = ListItem(List=data_2, Index=-1, Wrap=True)
p_n_c = PickNChoose(Pattern=item, Stream0="https://git-scm.com/downloads", Stream1="https://github.com/orgs/mottmacdonaldglobal")
openwwlink = CSharpScript(URL=p_n_c, ClickMe=Button())  # -> out, A; inputs URL: String, ClickMe: Boolean
# ---------- openwwlink: C# ----------
    System.Diagnostics.Process.Start(URL);
# ---------- end openwwlink ----------
R = ClusterOutput(p_n_c)
out = ClusterOutput(openwwlink.out)

# ==== cluster Clone
local_folder = Panel("\Documents\GitHub\grasshopper\")
gh_user_email = ClusterInput()
gh_user_name = ClusterInput()
user_name = ClusterInput()
repository_name = ClusterInput()
clone = ClusterInput()

concat = Concatenate(FragmentA="C:\Users\", FragmentE=user_name, FragmentD=local_folder)
concat_2 = Concatenate(FragmentA=concat, RepositoryName=repository_name, FragmentD="\")

create_git = CreateGitRepository(GH_user_name=gh_user_name, GH_user_email=gh_user_email, Initialize=clone)  # -> Report, Help
concat_3 = Concatenate(FragmentA="https://github.com/", GH_user_name=gh_user_name, FragmentC="/", RepositoryName=repository_name, FragmentD="/")

# ---- group: Create a folder for your project
gate = StreamGate(Stream=clone, Gate=clone)  # -> Target0, Target1
path = GitPath(TargetFolder=concat_2, Create_path=Toggle(True), Set=gate.Target1)  # -> Report, Help

# ----
clone_2 = CloneRepository(URL=concat_3, Location=concat, GH_user_name=gh_user_name, GH_user_email=gh_user_email, MarshallingSignalParameter=clone)
url = ClusterOutput(concat_3)
targetfolder = ClusterOutput(concat_2)
report = ClusterOutput(path.Report)
help = ClusterOutput(path.Help)

# ==== cluster Cluster_2
message = ClusterInput()
push = ClusterInput()
message_2 = Data(message)
push_2 = Data(push)

commit = BooleanToggle(True)
gate = StreamGate(Stream=push_2, Gate=push_2)  # -> Target0, Target1
gate_2 = StreamGate(Stream=0, Gate=gate.Target1)  # -> Target0, Target1
gate_3 = StreamGate(Stream=commit, Gate=gate.Target1)  # -> Target0, Target1
select_branch = SelectBranch(Index=gate_2.Target1)  # -> Branch, Branches
push_3 = PushToRepository(Branch=select_branch.Branch, Push=gate.Target1)
commit_2 = CommitChanges(Message=message_2, Commit=gate_3.Target1)  # -> Report, Help

help = ClusterOutput(push_3)
report = ClusterOutput(commit_2.Report)

# ==== cluster Plugins
githopper = Panel("Githopper, Version=1.3.1")
_0_1 = ClusterInput()
panel = Panel("""In order to successfully run the code in this repository, it is recommended that you copy all external plugins used within the script to AppData folder and zip it.

Path to the Grasshopper plugins:
C:\Users\"your username"\AppData\Roaming\Grasshopper\Libraries""")
entwine = Entwine(Branch00=githopper, Branch01=_0_1, FlattenInputs=True)  # -> flatten(Result)
split = TextSplit(Text=entwine, Separators=",")
split_2 = SplitList(List=split, Index="2")  # -> ListA, ListB
join = TextJoin(Text=split_2.ListA, Join=" -")
join_2 = TextJoin(Text=flatten(join), Join=", ")
entwine_2 = Entwine(Branch00="List of external packages:", Branch01=join_2, Branch02=panel, FlattenInputs=True)  # -> flatten(Result)
result = ClusterOutput(entwine_2)

# ==== cluster Cluster_3
script_file_path_automatic = ClusterInput()
script_file_path_automatic_2 = Data(script_file_path_automatic)
split = TextSplit(Text=script_file_path_automatic_2, Separators=".")
split_2 = TextSplit(Text=flatten(script_file_path_automatic_2), Separators="\")
item = ListItem(List=split_2, Index=-1, Wrap=True)
item_2 = ListItem(List=split, Index=0, Wrap=True)
fsim = FindSimilarMember(Data="Users", Set=split_2)  # -> Hit, expr("x+1", Index)
split_3 = TextSplit(Text=flatten(item), Separators=".")
concat = Concatenate(FragmentA=item_2, FragmentB=".jpg")
C = ClusterInput()
item_3 = ListItem(List=split_3, Index=0, Wrap=True)
item_4 = ListItem(List=split_2, Index=fsim.Index, Wrap=True)
canvascap = CaptureGHCanvas(Capture=C, ScaleFactor=1, SaveLocation=concat, BackgroundColor=RGBA(255, 255, 255, 225))
file_name = ClusterOutput(item_3)
username = ClusterOutput(item_4)
P = ClusterOutput(canvascap)
